# Grasshopper definition assignment01_mesh_3d_heightmapper SETUP_jacintomoros.gh (Grasshopper 1.0.7)

panel = Panel("https://github.com/jacintomoros/")

# ----
# Extract the BnW image frome this web:
# 
# https://tangrams.github.io/heightmapper/
file_path = FilePath("D:\MASTER IAAC\BIMSC21\CLOUD-BASED DATA MANAGMENT[CRHINO.COMPUTE]\git\bimsc21-datamgmt-by-jacintomoros\bimsc21-datamgmt assignments\Week 01\Heightmapper\Example Images\heightmapper-1641908612878.png")
file_path_to_image = GetString(file_path, AtLeast=1, AtMost=2147483647)

resolucion_de_la_imagen = Slider(14, range=1..100)
m = Slider(100, range=0..100)
resolution_image = GetInteger(resolucion_de_la_imagen, AtLeast=1, AtMost=2147483647, Maximum=100, Minimum=-2147483648)
maximum_height = GetNumber(m, AtLeast=1, AtMost=2147483647, Maximum=1.797693135e+308, Minimum=-1.797693135e+308)
import_image = ImportImage(File=file_path_to_image)
bounding_box = BoundingBox(Content=import_image, Plane=PlaneXY(0, 0, 0))  # -> Box, Box_2
dimensions = Dimensions(Surface=bounding_box.Box)  # -> UDimension, VDimension
division = Division(A=dimensions.UDimension, B=resolution_image)
division_2 = Division(A=dimensions.VDimension, B=resolution_image)
import_image_2 = ImportImage(File=file_path_to_image, XSamples=division, YSamples=division_2)
deconstruct_mesh = DeconstructMesh(Mesh=import_image_2)  # -> Vertices, Faces, Colours, Normals
split_ahsl = SplitAHSL(Colour=deconstruct_mesh.Colours)  # -> Alpha, Hue, Saturation, Luminance
construct_domain = ConstructDomain(DomainStart=0, DomainEnd=maximum_height)
deconstruct = Deconstruct(Point=deconstruct_mesh.Vertices)  # -> XComponent, YComponent, ZComponent
remap_numbers = RemapNumbers(Value=split_ahsl.Luminance, Source=Domain(0, 1), Target=construct_domain)  # -> Mapped, Clipped
construct_point = ConstructPoint(XCoordinate=deconstruct.XComponent, YCoordinate=deconstruct.YComponent, ZCoordinate=remap_numbers.Mapped)
construct_mesh = ConstructMesh(Vertices=construct_point, Faces=deconstruct_mesh.Faces, Colours=deconstruct_mesh.Colours)

# ---- group: RH_OUT:Terrain
mesh = Mesh(construct_mesh)
